# Grasshopper definition visualization.gh (Grasshopper 1.0.7)
# plug-ins: Human

number_slider = Slider(90, range=0..100)
path = FilePath("C:\Users\Ellen\Desktop\RC15\skill课作业\第一部分\2.csv")
geo = Geometry(<brep referenced from the Rhino model>)
file = ReadFile(File=path, PerLineParse=True)
point = Point([<point referenced from the Rhino model> x573])
geometry = Geometry(<curve referenced from the Rhino model>)
cull_i = CullIndex(List=file, Indices=0, Wrap=True)
sdivide = DivideSurface(Surface=reparameterize(geo), UCount=number_slider, VCount=Slider(68, range=0..100))  # -> simplify(Points), Normals, Parameters
deconstruct = Deconstruct(Point=point)  # -> XComponent, YComponent, ZComponent
polyline = PolyLine(Vertices=point, Closed=False)
split = TextSplit(Text=cull_i, Separators=",")
panel = Panel(split)
project_point = ProjectPoint(Point=point, Direction=Vector(0, 0, -1), Geometry=geometry)  # -> Point, Index
panel_2 = Panel(cull_i)
unit_z = UnitZ(Factor=1)
addition = Addition(A=deconstruct.ZComponent, B=Slider(0, range=0..100))
image = ImageSampler(
    sdivide.Parameters,
    FilePath="C:\Users\Ellen\Desktop\RC15\skill课作业\第一部分\黑白.png",
    Filter="Value",
    Interpolate=True,
    Umax=1,
    Umin=0,
    Vmax=1,
    Vmin=0,
    Wrap=1)
panel_3 = Panel(sdivide.Points)
item = ListItem(List=split, Index="0", Wrap=True)  # -> graft(Item), graft(Item1)
item_2 = ListItem(List=split, Index="11", Wrap=True)  # -> simplify(Item)
panel_4 = Panel(image)
line_sdl = LineSDL(Start=project_point.Point, Direction=unit_z, Length=addition)
panel_5 = Panel(item.Item)
graph = GraphMapper(
    image,
    x0=0,
    x1=1,
    y0=0,
    y1=1,
    container_name="Bezier",
    cpx=[0, 0, 0.5764890313, 1],
    cpy=[0, 0.5986346006, 0.812559247, 1])
bnd = Bounds(Numbers=flatten(item_2))
pt = ConstructPoint(XCoordinate=item.Item, YCoordinate=item.Item1, ZCoordinate=item_2)
Z = UnitZ(Factor=graph)
dedomain = DeconstructDomain(Domain=bnd)  # -> Start, End
unit_x = UnitX(Factor=Slider(0, range=0..1000))
gradient = Gradient(
    LowerLimit=dedomain.Start,
    UpperLimit=dedomain.End,
    Parameter=item_2,
    stops=[0: RGB(128, 255, 255), 0.0552: RGB(0, 255, 255), 0.292: RGB(128, 128, 255), 0.483: RGB(147, 112, 219), 1: RGB(238, 130, 238)])
multiplication = Multiplication(A=Z, B=Slider(500, range=0..500))
move = Move(Geometry=sdivide.Points, Motion=multiplication)  # -> Geometry, Transform
panel_6 = Panel(Z)
move_2 = Move(Geometry=pt, Motion=unit_x)  # -> Geometry, Transform
unit_y = UnitY(Factor=expr("-x", Slider(423, range=0..1000)))
srfgrid = SurfaceFromPoints(Points=flatten(move.Geometry), UCount=expr("x+1", number_slider), Interpolate=False)
point_2 = Point([<point referenced from the Rhino model> x2166])
move_3 = Move(Geometry=move_2.Geometry, Motion=unit_y)  # -> Geometry, Transform
xy = XYPlane(Origin=Point(0, 0, 0))
series = Series(Start=Slider(0, range=0..10), Step="10", Count=Slider(22, range=0..1000))
polyline_2 = PolyLine(Vertices=point_2, Closed=Toggle(False))
unit_z_2 = UnitZ(Factor=expr("-x", Slider(231, range=0..1000)))
createatts = CreateAttributes(Color=gradient, enableFullPath=False)
contour = ContourEx(Shape=srfgrid, Plane=xy, Offsets=series)
eval = EvaluateCurve(Curve=contour, Parameter=0)  # -> Point, Tangent, Angle
move_4 = Move(Geometry=move_3.Geometry, Motion=unit_z_2)  # -> Geometry, Transform
pdecon = Deconstruct(Point=flatten(eval.Point))  # -> XComponent, YComponent, ZComponent
bake = BakeGeometry(Bake=Button(), Geometry=move_4.Geometry, Attributes=createatts, DeleteOldBakes=False, PreserveTrees=False)
preview = CustomPreview(Geometry=move_4.Geometry, Material=gradient)
bnd_2 = Bounds(Numbers=pdecon.ZComponent)
dedomain_2 = DeconstructDomain(Domain=bnd_2)  # -> Start, End
gradient_2 = Gradient(
    LowerLimit=dedomain_2.Start,
    UpperLimit=dedomain_2.End,
    Parameter=pdecon.ZComponent,
    stops=[0: RGB(128, 255, 255), 0.147: RGB(0, 255, 255), 0.424: RGB(128, 128, 255), 0.699: RGB(147, 112, 219), 1: RGB(238, 130, 238)])
geometry_2 = Geometry(<brep referenced from the Rhino model>)
point_3 = Point([<point referenced from the Rhino model> x573])
deconstruct_2 = Deconstruct(Point=point_3)  # -> XComponent, YComponent, ZComponent
project_point_2 = ProjectPoint(Point=point_3, Direction=Vector(0, 0, -1), Geometry=geometry_2)  # -> Point, Index
number_slider_2 = Slider(35, range=0..100)
addition_2 = Addition(A=deconstruct_2.ZComponent, B=Slider(0, range=0..100))
preview_2 = CustomPreview(Geometry=flatten(contour), Material=gradient_2)
createatts_2 = CreateAttributes(Color=gradient_2, GroupIndices="1", enableFullPath=False)
createatts_3 = CreateAttributes(Color=gradient_2, GroupIndices="1", enableFullPath=False)
bnd_3 = Bounds(Numbers=addition_2)
line_sdl_2 = LineSDL(Start=project_point_2.Point, Direction=Vector(0, 0, 1), Length=addition_2)
dedomain_3 = DeconstructDomain(Domain=bnd_3)  # -> Start, End
bake_2 = BakeGeometry(Bake=Button(), Geometry=flatten(contour), Attributes=createatts_2, DeleteOldBakes=False, PreserveTrees=False)
gradient_3 = Gradient(
    LowerLimit=dedomain_3.Start,
    UpperLimit=dedomain_3.End,
    Parameter=addition_2,
    stops=[0: RGB(128, 255, 255), 0.0552: RGB(0, 255, 255), 0.3: RGB(128, 128, 255), 0.564: RGB(147, 112, 219), 1: RGB(238, 130, 238)])
custom_preview = CustomPreview(Geometry=line_sdl_2, Material=gradient_3)
createatts_4 = CreateAttributes(Color=gradient_3, enableFullPath=False)
bake_3 = BakeGeometry(Bake=Button(), Geometry=line_sdl_2, Attributes=createatts_4, DeleteOldBakes=False, PreserveTrees=False)
